# Grasshopper definition subtract_forked_on_test09.gh (Grasshopper 1.0.7)
# plug-ins: Kangaroo2 Components

B = B()
A = A()
panel = Panel("Another fork")
subtraction = Subtraction(A=A, B=B)
R = Result(subtraction)
cluster = Cluster()
coplanar = CoPlanar(Strength=1)

# ==== cluster Cluster
A = ClusterInput()
B = ClusterInput()
addition = Addition(A=A, B=B)
R = ClusterOutput(addition)
